# Grasshopper definition sample.gh (Grasshopper 1.0.7)
# plug-ins: tcp_connnection

division = Division(A="30", B="3")
series = Series(Start=0, Step=1, Count="30")
partition = PartitionList(List=series, Size=division)  # -> simplify(Chunks)
bang = ExplodeTree(Data=partition)  # -> Branch0, Branch1, Branch2
pt = ConstructPoint(XCoordinate=bang.Branch0, YCoordinate=bang.Branch1, ZCoordinate=bang.Branch2)
panel = Panel(pt)
tcp_conn = Tcp_conn(IpAddress="127.0.0.1", Port=3141, Run=Toggle(False), Points=pt)  # -> ConnectionStatus, ReturnedPoint, ReturnedScore
panel_2 = Panel(tcp_conn.ConnectionStatus)
panel_3 = Panel(tcp_conn.ReturnedPoint)
panel_4 = Panel(tcp_conn.ReturnedScore)
